test file "QuadcopterTests"

suite "FCS Communications"

  case "MAVLink Spoof" [simulation]
    model QuadArchitecture
    parameter set "Parameter Set 1": spoofTime = 8, varComms = 1, varThreat = 0  % QuadData.sldd
    parameter set "Parameter Set 2" (off): varComms = 1, varThreat = 1, spoofTime = 8  % QuadData.sldd
    parameter set "Parameter Set 3" (off): spoofTime = 8, varComms = 2, varThreat = 1  % QuadData.sldd
    assessment "Assessment1": At any point of time, Mode ~= EmergencyOff must be true
      Mode: signal QuadArchitecture/AirVehicle/FCS/ModeLogic, port 1
      EmergencyOff: expression uint8(3)
    iterations:
      Iteration1: ParameterSet "Parameter Set 1"  % MAVLink communication with no spoofing threat
      Iteration2: ParameterSet "Parameter Set 2"  % MAVLink communication with spoofing threat
      Iteration3: ParameterSet "Parameter Set 3"  % Custom communication with spoofing threat